vi "RiskReduction2.gvi"   [LabVIEW NXG 2.0.0]
panel controls:
  "Numeric": f64
  "Numeric_3": f64
panel indicators:
  "Numeric_2": f64
  "Numeric_4": f64
diagram:
  for {
    Add($Numeric, 5) -> w1
    Multiply(w1, 2) -> w2
    $Numeric_2 <- w2
    Subtract(x=$Numeric_3, y=2) -> w3
    $Numeric_4 <- w3
  }
